% Simulink data dictionary params.sldd
% references common.sldd

MyAlias = Simulink.AliasType(BaseType="int32")

MyBkpt = Simulink.Breakpoint(
  Breakpoints=Simulink.lookuptable.Breakpoint(
    Value=[1 2 3],
    TunableSizeName="N",
    TunableSizeValue=-1,
    Dimensions=[1 3],
    FieldName="BP"))

MyBus = Simulink.Bus()
  x: double
  y: int32

MyConnBus = Simulink.ConnectionBus()
  c1: Connection: <domain name>

MyEnum = enum()
  enum1 = 0
  Red = 0  % red state
  Green = 1  % green state

MyLUT = Simulink.LookupTable(
  Table=Simulink.lookuptable.Table(Value=[1 2 3 4], Dimensions=[1 4], FieldName="Table"),
  BreakpointsSpecification="Explicit values",
  Breakpoints=Simulink.lookuptable.Breakpoint(
    Value=[10 20 30 40],
    TunableSizeName="N1",
    TunableSizeValue=-1,
    Dimensions=[1 4],
    FieldName="BP1"),
  AllowMultipleInstancesOfTypeToHaveDifferentTableBreakpointSizes=false)

MyNumType = Simulink.NumericType(DataTypeMode="Fixed-point: binary point scaling", SignednessBool=true, WordLength=16, FixedExponent=-8)
MyValueType = Simulink.ValueType(DataType="double", Unit="m", be=Simulink.BusElement(Name="a", DataType="double"))
MyVarCtrl = Simulink.VariantControl(Value=1, ActivationTime="update diagram", ValueType="Numeric")
MyVarExpr = Simulink.VariantExpression(Condition="A == 1")

MyVarVar = Simulink.VariantVariable(
  struct(
    Choices=[struct(Condition="A == 1", Value=10), struct(Condition="A == 2", Value=20)],
    Specification=[],
    Bank=[]))

boolFlag = true
boolVec = [true false true]
charStr = "hello"
colVec = [1; 2; 3]
cplxScalar = 3.0+4.0i
cplxVec = [1.0+1.0i 2.0-2.0i]
emptyD = []
gravity = Simulink.Parameter(9.81, DataType="double", Min=0, Max=100, Unit="m/s^2")  % gravity accel
i16Scalar = int16(-1234)
i32Scalar = int32(42)
i32Vec = int32([5 6 7])
i8Scalar = int8(-12)
mat2x2 = [1 2; 3 4]
mat2x3 = [1 2 3; 4 5 6]
myCell = {1, "two", [3 4]}
myStruct = struct(a=1, b=[2 3], c="txt")
negD = -9.5
nestedStruct = struct(inner=struct(x=1, y=2), name="n")
pInt16 = Simulink.Parameter(int16(5))
rowVec = [10 20 30 40]
scalarD = 3.14
sglScalar = single(2.5)
sig1 = Simulink.Signal(DataType="single", Min=-10, Max=10)
strArray = "a", "bb", "ccc"
strScalar = "worldString"
structArray = [struct(v=1), struct(v=2)]
u16Scalar = uint16(60000)
u32Scalar = uint32(70000)
u8Scalar = uint8(200)