% Simulink data dictionary variantbank_r2027a_binary.sldd

ciA = Simulink.VariantBankCoderInfo(
  struct(HeaderFile="h.h", DefinitionFile="d.c", PreStatement="pre", PostStatement="post", Qualifier="Const"))

ciB = Simulink.VariantBankCoderInfo(
  struct(HeaderFile="", DefinitionFile="", PreStatement="", PostStatement="", Qualifier="None"))

vb1 = Simulink.VariantBank(
  struct(
    Name="bankOne",
    Description="two\nlines, it's",
    VariantConditions={"W > 0 && ~X"},
    AllChoicesCoderInfo="ciA",
    ActiveChoiceCoderInfo="ciA",
    BankCoderInfo="ciA"))

vbD = Simulink.VariantBank(
  struct(
    Name="",
    Description="",
    VariantConditions=[],
    AllChoicesCoderInfo="",
    ActiveChoiceCoderInfo="",
    BankCoderInfo=""))

vbN = Simulink.VariantBank(
  struct(
    Name="bankA",
    Description="desc A",
    VariantConditions={"V == 1", "V == 2"},
    AllChoicesCoderInfo="ciA",
    ActiveChoiceCoderInfo="ciB",
    BankCoderInfo=""))