% Simulink data dictionary sparse_binary.sldd

c = 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
dAllZero = repmat(0, 3, 4)
dCol = [0; 3; 0; 0; 5]
dComplex = [1.0+2.0i 0.0+0.0i 0.0+0.0i 4.0-0.25i; 0.0+0.0i 0.0+0.0i -0.0-3.0i 0.0+0.0i; 0.5+0.0i 0.0+0.0i 0.0+0.0i 0.0+0.0i]

dDiag = [1 0 0 0 0 0 0 0 0 0
 0 2 0 0 0 0 0 0 0 0
 0 0 3 0 0 0 0 0 0 0
 0 0 0 4 0 0 0 0 0 0
 0 0 0 0 5 0 0 0 0 0
 0 0 0 0 0 6 0 0 0 0
 0 0 0 0 0 0 7 0 0 0
 0 0 0 0 0 0 0 8 0 0
 0 0 0 0 0 0 0 0 9 0
 0 0 0 0 0 0 0 0 0 10]

dEmpty = []
dLogical = [true false false; false false true]
dNonFinite = [Inf 0; -Inf NaN]
dRow = [0 2 0 4 0]
dSingle = single([0 1.5; 2.5 0; 0 -4])
fhAlias = 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
numAlias = dexsparse.NumAlias(K=7, BaseType="double")
pDense = Simulink.Parameter([0 5 0; 0 0 0; 6 0 0])
pSp = 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
pSpComplex = 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
pSpLogical = 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
spAllZero = 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
spBig = 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
spCol = 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
spComplex = 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
spDiag = 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
spEmpty = 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
spLogical = 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
spNonFinite = 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
spRow = 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
spSingle = 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
spTall = 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
st = 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