% Simulink data dictionary arch_service_binary.sldd

ServiceInterface = Simulink.ServiceBus()
  f: y = f(u), Asynchronous=false, Arguments=[Simulink.BusElement(Name="u", DataType="double"), Simulink.BusElement(Name="y", DataType="double")]
  g: [a,b] = g(g), Asynchronous=false, Arguments=[Simulink.BusElement(Name="g", DataType="double"), Simulink.BusElement(Name="a", DataType="double"), Simulink.BusElement(Name="b", DataType="double")]