% Simulink data dictionary object_array_binary.sldd

paramArray = [Simulink.Parameter(Description="first", Value=int32(10)), Simulink.Parameter(Description="second", Value=int32(20)), Simulink.Parameter(Description="third", Value=int32(30))]
usageArray = [Simulink.VariableUsage(Name="Ka", Source="f14", SourceType="model workspace"), Simulink.VariableUsage(Name="Kf", Source="f14", SourceType="model workspace")]