% Simulink data dictionary object_props_binary.sldd

a = struct(b=5, c=struct(d=42))

fleetObject = Fleet(
  FleetName="east",
  Count=3,
  Lead=Garage(Location="Boston", Capacity=25),
  Notes=struct(a=struct(b=5), c=struct(d=42)))

vehicleObject = Vehicle(
  Wheels=6,
  Engine=Engine(Cylinders=8, Displacement=5.7, Label="V8"),
  Specs=struct(mass=2200, color="blue"),
  Tags={"suv", "electric"})