% Simulink data dictionary stream_objects_binary.sldd

arr = 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
cPh = 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
nested = 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
pSp = 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
pStruct = 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
plainP = Simulink.Parameter(9)  % plain
plainS = struct(x=1)
sPh = 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
sTh = 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
shared = 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
sigH = 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