% Simulink data dictionary headerfile.sldd

hdrParam = Simulink.Parameter(3.14, StorageClass="ExportToFile", HeaderFile="params_hdr.h", DataType="double")  % param with header file
hdrSignal = Simulink.Signal(StorageClass="ExportToFile", HeaderFile="signals_hdr.h", DataType="double")  % signal with header file
plainParam = Simulink.Parameter(1, DataType="double")