% Simulink data dictionary elements.sldd

MyBus = Simulink.Bus()
  x: int32[2], Min=-5, Max=10, Unit="m/s", Complexity="complex"  % a populated element
  y: double

MyConnBus = Simulink.ConnectionBus()
  c1: Connection: <domain name>

MyServiceBus = Simulink.ServiceBus()
  f1, Asynchronous=false